# Grasshopper definition Wong, ARCH 741 Project GH.gh (Grasshopper 1.0.7)

extent_y = Slider(8, range=0..10)
min_height = Slider(2, range=0..11)
max_height = Slider(7, range=0..10)
number_slider = Slider(3, range=0..10)
list = ValueList({"One": 1, "Two": 2, "Three": 2² - 1, "Four": Sqrt(16)}, selected="Four")
pln = Plane(Plane(origin=(56.86554985, -37.49987507, 0), x=(0.986678737, 0.1626808837, 0), y=(0.1493731683, -0.9059658739, 0.3961230766)))
box = Box({Plane=Plane(origin=(31.96626822, -38.65510932, 0), x=(0, 1, 0), y=(1, 0, 0)), X=Domain(0, 15.78780439), Y=Domain(0, 12.80539176), Z=Domain(0, 11.36123181)})
dom = ConstructDomain(DomainStart=min_height, DomainEnd=max_height)
sqgrid = Square(Plane=PlaneXY(0, 0, 0), Size=list, ExtentX=extent_y, ExtentY=extent_y)  # -> Cells, Points
series = Series(Start=Slider(0, range=0..20), Step=Slider(4, range=0..4), Count=number_slider)
polygon = Polygon(Plane=PlaneXY(0, 0, 0), Radius=3, Segments=6, FilletRadius=0)  # -> Polygon, Length
Y = UnitY(Factor=1)
Z = UnitZ(Factor=1)
_90_0_90 = Slider(4, range=0..20)
range = Range(Domain=Domain(0, 1), Steps=expr("x-1", number_slider))
polygon_2 = Polygon(
    Plane=PlaneXY(0, 0, 0),
    Radius=Slider(20, range=0..20),
    Segments=Slider(4, range=0..8),
    FilletRadius=Slider(1, range=0..10))  # -> Polygon, Length; disabled
number_slider_2 = Slider(4, range=0..20)
rad = Radians(Degrees=Slider(-34, range=-90..90))
pts = Point(flatten(sqgrid.Points))
Z_2 = UnitZ(Factor=series)
viewer = ParamViewer(sqgrid.Points)
arrpolar = PolarArray(Geometry=box, Plane=pln, Count=Slider(50, range=0..50), Angle=degrees(Slider(360, range=0..360)))  # -> Geometry, Transform
vrot = Rotate(Vector=Y, Axis=Z, Angle=rad)
lng = ListLength(List=pts)
pt = PointXYZ(XComponent=0, YComponent=0, ZComponent=0)
move = Move(Geometry=polygon_2.Polygon, Motion=Z_2)  # -> Geometry, Transform
random = Random(Range=dom, Number=lng, Seed=2)
graph = GraphMapper(range, x0=0, x1=1, y0=0, y1=1, container_name="Sine", Equation_px=[0, 1], Equation_py=[0, 1])  # disabled
line = LineSDL(Start=pt, Direction=vrot, Length=number_slider_2)
Z_3 = UnitZ(Factor=random)
X = UnitX(Factor=_90_0_90)
cp = ControlPoints(Curve=move.Geometry)  # -> Points, Weights, Knots
move_2 = Move(Geometry=pts, Motion=Z_3)  # -> Geometry, Transform
move_3 = Move(Geometry=line, Translation=X)  # -> Geometry, Transform
panel = Panel("""0
0
6""")
avr = Average(Input=cp.Points)  # -> flatten(ArithmeticMean)
end = EndPoints(Curve=line)  # -> Start, End
end_2 = EndPoints(Curve=move_3.Geometry)  # -> Start, End
box_2 = CenterBox(Base=move_2.Geometry, X=1, Y=1, Z=1)
ln = Line(PointA=end.Start, PointB=end_2.Start)
ln_2 = Line(PointA=end.End, PointB=end_2.End)
scale_nu = ScaleNU(Geometry=move.Geometry, Plane=avr, ScaleX=1, ScaleY=1, ScaleZ=1)  # -> Geometry, Transform
path = DataPath()
path_2 = ConstructPath(Indices=panel)
partition = PartitionList(List=box_2, Size=extent_y)
merge = Merge(Data1=ln, Data2=ln_2, Data3=line, Data4=move_3.Geometry)
branch = TreeBranch(Tree=partition, Path=path_2, MaintainPaths=True)
line_2 = Line(Line((133.1973546, 0, 19.94556265), (139.4341262, 3.31615029, 19.94556265)))
viewer_2 = ParamViewer(box_2)  # disabled
arrrec = RectangularArray(
    Geometry=merge,
    Cell={Plane=PlaneXY(0, 0, 0), Size=Domain2(u=0..10, v=0..5)},
    XCount=Slider(10, range=0..10),
    YCount=Slider(10, range=0..10))  # -> Geometry, Transform
rotax = RotateAxis(Geometry=arrrec.Geometry, Angle=Slider(4, range=0..10), Axis=line_2)  # -> Geometry, Transform
